# Grasshopper definition addition.gh (Grasshopper 1.0.7)

number_1 = GetInteger(AtLeast=1, AtMost=1, Maximum=2147483647, Minimum=-2147483648, TreeAccess=False)
number_2 = GetInteger(AtLeast=1, AtMost=1, Maximum=2147483647, Minimum=-2147483648, TreeAccess=False)
addition = Addition(A=number_1, B=number_2)
context_print = ContextPrint(Text=addition)
