# Grasshopper definition ghCompute.gh (Grasshopper 1.0.7)

# ----
# Inputs
number2 = GetNumber(
    Slider(3, range=0..10),
    AtLeast=1,
    AtMost=2147483647,
    Maximum=1.797693135e+308,
    Minimum=-1.797693135e+308,
    TreeAccess=True)

# ---- group: RH_IN:number1
num = Number(Slider(3, range=0..10))

# ----
multiplication = Multiplication(A=num, B=number2)

# ---- group: RH_OUT:result
# Outputs
data = Data(multiplication)

# ----
panel = Panel(data)
